# Grasshopper definition Bennu_1.0.0.gh (Grasshopper 1.0.8)

simplified_farnsworth_house_geometry = Brep(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)
source = Point(Point(5185.405263, 1512.070639, -2645.860525))

ray_tracer = CSharpScript(
    mesh=simplified_farnsworth_house_geometry,
    originPt=source,
    rayLength=Slider(35, range=0..1000),
    rayCount=Slider(29, range=0..100),
    maxBounces=Slider(6, range=0..100))  # -> Rays, Hits; inputs mesh: Mesh, originPt: Point3d, rayLength: Double, rayCount: Int32, maxBounces: Int32
# ---------- ray_tracer: C# ----------
using Rhino;
using Rhino.Geometry;
using System;
using System.Collections.Generic;

public class Script_Instance : GH_ScriptInstance
{
    private void RunScript(
		Mesh mesh,
		Point3d originPt,
		double rayLength,
		int rayCount,
		int maxBounces,
		ref object Rays,
		ref object Hits)
    {
        if (mesh == null) return;
        // Unit correction
        double scale = RhinoMath.UnitScale(RhinoDoc.ActiveDoc.ModelUnitSystem, UnitSystem.Meters);
        double correctedRayLength = rayLength / scale;

        // Ray tracing
        RayCasting3D raycaster = new RayCasting3D(mesh, originPt, correctedRayLength, rayCount, maxBounces);
        List<Line> rayLines;
        List<Point3d> hitPoints;
        raycaster.ComputeRays(out rayLines, out hitPoints);

        Rays = rayLines;
        Hits = hitPoints;
    }

    // Ray Tracing Class
    public class RayCasting3D
    {
        private Mesh _mesh;
        private Point3d _origin;
        private double _rayLength;
        private int _rayCount;
        private int _maxBounce;

        public RayCasting3D(Mesh mesh, Point3d origin, double rayLength, int rayCount, int maxBounce)
        {
            _mesh = mesh;
            _origin = origin;
            _rayLength = rayLength;
            _rayCount = Math.Max(rayCount, 10);
            _maxBounce = maxBounce;
        }

        public void ComputeRays(out List<Line> rays, out List<Point3d> intersections)
        {
            rays = new List<Line>();
            intersections = new List<Point3d>();

            for (int i = 0; i < _rayCount; i++)
            {
                // Fibonacci sphere sampling (uniform)
                double phi = Math.Acos(1 - 2 * (i + 0.5) / _rayCount);
                double theta = Math.PI * (1 + Math.Sqrt(5)) * i;

                Vector3d dir = new Vector3d(
                    Math.Sin(phi) * Math.Cos(theta),
                    Math.Sin(phi) * Math.Sin(theta),
                    Math.Cos(phi)
                );

                dir.Unitize();
                TraceRay(_origin, dir, rays, intersections);
            }
        }

        private void TraceRay(Point3d start, Vector3d direction, List<Line> rays, List<Point3d> hits)
        {
            Point3d currentOrigin = start;
            Vector3d dir = direction;

            for (int bounce = 0; bounce < _maxBounce; bounce++)
            {
                var ray = new Ray3d(currentOrigin, dir);
                double t = Rhino.Geometry.Intersect.Intersection.MeshRay(_mesh, ray);

                if (t < 0 || t > _rayLength) break;

                var hitPt = ray.PointAt(t);
                rays.Add(new Line(currentOrigin, hitPt));
                hits.Add(hitPt);

                var mp = _mesh.ClosestMeshPoint(hitPt, 0.0);
                if (mp == null) break;

                var normal = _mesh.NormalAt(mp);

                // Reflection
                dir = dir - 2 * Vector3d.Multiply(dir * normal, normal);
                dir.Unitize();

                // Offset to avoid self-intersection
                currentOrigin = hitPt + dir * 0.01;
            }
        }
    }
}
# ---------- end ray_tracer ----------
line = Line(ray_tracer.Rays)
